# Dynamo graph Auto_Title_Block_Swapping.dyn (Dynamo 2.6.1.8786)

family_types = FamilyTypes("Dornan Sheet Layout A2 - Landscape -  Template:Dornan Sheet Layout A2 - Landscape -  Template")
byFamilyType = FamilyInstance.ByFamilyType(familyType=family_types)
string = StringInput("Type")
family_types_2 = FamilyTypes("Dornan Sheet Layout A2 - Landscape - Template:Dornan Sheet Layout A2 - Landscape - Template")
setParameterByName = Element.SetParameterByName(element=byFamilyType, parameterName=string, value=family_types_2)
